# Grasshopper definition FloorAreaTest.gh (Grasshopper 1.0.7)
# plug-ins: eleFront

reflay = ReferenceByLayer(LayerName="Plans*", lightweight=False)
reflay_2 = ReferenceByLayer(LayerName="Program*", lightweight=False, DisableAutoUpdate=False)
geometry = EleFrontDataDescription(flatten(reflay), ShiftDepth=0, isNameSet=False)
geometry_2 = EleFrontDataDescription(flatten(reflay_2), ShiftDepth=0, isNameSet=False)
ef_att = EleFrontAttributes(Attributes=geometry)
tsort = SortText(Keys=ef_att, Values=geometry, Culture=127)  # -> Keys, Values
geometry_3 = EleFrontDataDescription(flatten(geometry_2), ShiftDepth=0, isNameSet=False)
values = EleFrontDataDescription(tsort.Values, ShiftDepth=0, isNameSet=False)
split = TextSplit(Text=tsort.Keys, Separators=":")
area = Area(Geometry=geometry_3)  # -> Area, Centroid
result = EleFrontDataDescription(split, ShiftDepth=0, isNameSet=False)
geometry_4 = EleFrontDataDescription(graft(geometry_3), ShiftDepth=0, isNameSet=False)
incurves = PointInCurves(Point=area.Centroid, Curves=values)  # -> Relationship, Index, Point
item = ListItem(List=reverse(result), Index=0, Wrap=True)
geometry_5 = EleFrontDataDescription(geometry_4, ShiftDepth=1, isNameSet=False)
geometry_6 = EleFrontDataDescription(geometry_5, ShiftDepth=0, isNameSet=False)
relationship = EleFrontDataDescription(incurves.Relationship, ShiftDepth=0, isNameSet=False)
geometry_7 = EleFrontDataDescription(geometry_5, ShiftDepth=0, isNameSet=False)
index = EleFrontDataDescription(incurves.Index, ShiftDepth=0, isNameSet=False)
point = EleFrontDataDescription(incurves.Point, ShiftDepth=0, isNameSet=False)
ef_att_2 = EleFrontAttributes(Attributes=geometry_6)  # -> Attributes, Keys, Values, Name, Layer, ColourSource, DisplayColour, MaterialSource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
item_2 = EleFrontDataDescription(item, ShiftDepth=0, isNameSet=False)
attributes = EleFrontDataDescription(ef_att_2.Attributes, ShiftDepth=0, isNameSet=False)
name = EleFrontDataDescription(ef_att_2.Name, ShiftDepth=0, isNameSet=False)
layer = EleFrontDataDescription(ef_att_2.Layer, ShiftDepth=0, isNameSet=False)
item_3 = ListItem(List=flatten(item_2), Index=index, Wrap=True)
item_4 = EleFrontDataDescription(flatten(item_3), ShiftDepth=0, isNameSet=False)
split_2 = TextSplit(Text=layer, Separators=":")
result_2 = EleFrontDataDescription(split_2, ShiftDepth=-1, isNameSet=False)
geometry_8 = EleFrontDataDescription(geometry_7, ShiftDepth=0, isNameSet=False)
item_5 = EleFrontDataDescription(graft(item_4), ShiftDepth=0, isNameSet=False)
item_6 = ListItem(List=reverse(result_2), Index=0, Wrap=True)
item_7 = EleFrontDataDescription(item_5, ShiftDepth=1, isNameSet=False)
name_2 = EleFrontDataDescription(name, ShiftDepth=0, isNameSet=False)
area_2 = Area(Geometry=geometry_8)  # -> Area, Centroid
panel = Panel("""Level
Program
Name
Area""")
round = Round(Number=area_2.Area)  # -> Nearest, Floor, Ceiling
merge = Merge(Data1=item_7, Data2=item_6, Data3=name_2, Data4=round.Nearest)
ef_att_3 = EleFrontAttributes(Attributes=attributes, Keys=panel, Values=merge, Name="Test Name")  # -> Attributes, Keys, Values, Name, Layer, ColourSource, DisplayColour, MaterialSource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
geometry_9 = EleFrontDataDescription(geometry_8, ShiftDepth=0, isNameSet=False)
attributes_2 = EleFrontDataDescription(ef_att_3.Attributes, ShiftDepth=0, isNameSet=False)
getkv = GetAllKeysValues(AttributesOrAttributedGeometry=attributes_2)  # -> Keys, Values, BakeName
keys = EleFrontDataDescription(getkv.Keys, ShiftDepth=0, isNameSet=False)
values_2 = EleFrontDataDescription(getkv.Values, ShiftDepth=0, isNameSet=False)
geometry_10 = EleFrontDataDescription(geometry_9, ShiftDepth=0, isNameSet=False)

# ---- group: Output: Attribute Table
geo = Geometry(geometry_10)
keys_2 = Text(keys)
values_3 = Text(values_2)
