# Grasshopper definition All_Params.gh (Grasshopper 1.0.7)
# plug-ins: eleFront

offse_slider = Slider(1.2, range=0..3)

# ---- group: Input: Native Controls
offse_slider_2 = Slider(0.25, range=0..1)
panel = Panel()
blocks = ValueList({"One": 1, "Two": 2, "Three": 2² - 1, "Four": Sqrt(16)}, selected="One")
layers = ValueList({"One": 1, "Two": 2, "Three": 2² - 1, "Four": Sqrt(16)}, selected="One")
list = ValueList({"Dropdown1": "1", "Dropdown2": "2", "Dropdown3": "3"}, selected="Dropdown1")
list_2 = ValueList({"Check1", "Check2", "Check3"}, selected="Check1")
boolean_toggle = EleFrontDataDescription(Toggle(False), ShiftDepth=0, isNameSet=False)
number_slider = EleFrontDataDescription(offse_slider_2, ShiftDepth=0, isNameSet=False)
button = EleFrontDataDescription(Button(), ShiftDepth=0, isNameSet=False)
value_list = EleFrontDataDescription(list, ShiftDepth=0, isNameSet=False)
value_list_2 = EleFrontDataDescription(layers, ShiftDepth=0, isNameSet=False)
value_list_3 = EleFrontDataDescription(blocks, ShiftDepth=0, isNameSet=False)
value_list_4 = EleFrontDataDescription(list_2, ShiftDepth=0, isNameSet=False)
panel_2 = EleFrontDataDescription(panel, ShiftDepth=0, isNameSet=False)

# ----
layers_2 = ValueList({"Dropdown1": "1", "Dropdown2": "2", "Dropdown3": "3"}, selected="Dropdown2")

# ---- group: Input: Native Params
button_test = Boolean(Button())
bool_name = Boolean(Toggle(False))
num_name = Number(offse_slider)
layer = Text(layers_2)
path = FilePath()
integer = Integer("4")

# ----
panel_3 = Panel("""Button:
Toggle:
Slider:
Dropdown:
Int:""")
merge = Merge(Data1=button_test, Data2=bool_name, Data3=num_name, Data4=layer, Data5=integer)
number_2 = Slider(0.25, range=0..1)
concat = Concatenate(FragmentA="Toggle Setting:", FragmentB=bool_name)
concat_2 = Concatenate(FragmentA="Button Setting:", FragmentB=button_test)
concat_3 = Concatenate(FragmentA="Toggle Setting:", FragmentB=bool_name)
concat_4 = Concatenate(FragmentA=panel_3, FragmentB=merge)

# ---- group: Output Results
output = Text(concat_4)

# ---- group: Input: Contextual
get_line = GetLine(AtLeast=1, AtMost=1, Realtime=True, TreeAccess=False)
get_integer = GetInteger(AtLeast=1, AtMost=1, Maximum=2147483647, Minimum=-2147483648, TreeAccess=False)
get_point = GetPoint(AtLeast=1, AtMost=1, Realtime=True, TreeAccess=False)
get_string = GetString(AtLeast=1, AtMost=1, TreeAccess=False)
get_number = GetNumber(number_2, AtLeast=1, AtMost=1, Maximum=1.797693135e+308, Minimum=-1.797693135e+308, TreeAccess=False)
get_file_path = GetFilePath(AtLeast=1, AtMost=1, TreeAccess=False)

# ----
panel_4 = Panel(get_string)
panel_5 = Panel(get_integer)
panel_6 = Panel(get_number)
dup = DuplicateData(Data=layer, Number=10, Order=True)
sph = Sphere(Base=PlaneXY(0, 0, 0), Radius=1)
Z = UnitZ(Factor=1)

# ---- group: Input: Geometry
circle = Circle()
brep = Brep()
mesh = Mesh()
srf = Surface()
line = Line()

# ----
move = Move(Geometry=sph, Motion=Z)  # -> Geometry, Transform

# ---- group: Output: Native
txt = Text(dup)
bool = Boolean(bool_name)
path_2 = FilePath()
num = Number(get_number)
int = Integer("3")

# ----
c_script = CSharpScript(x=line)  # -> out, A
# ---------- c_script: C# ----------
    
    var r = this.Component.Params.Input[0].Sources[0].ComponentGuid;
    
    A = r;
# ---------- end c_script ----------
srf_2 = Surface(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)
box = Box({Plane=PlaneXY(680.1627446, 1139.819106, 0), X=Domain(0, 138.2205414), Y=Domain(0, 155.0269175), Z=Domain(0, 230.3024356)})
panel_7 = Panel(c_script.A)

# ---- group: Output: Native Geometry
context_bake = ContextBake(Geometry=srf_2)
geo = Geometry(srf_2)
mesh_2 = Mesh(srf_2)
brep_2 = Brep(srf_2)
